# Dynamo graph AS224711-00-GetCurrentUserPythonTemplatePath_end.dyn (Dynamo 2.0.1.5055)

python_script = Python()  # unwired: IN[0]
# ---------- python_script.python (10 lines) ----------
import sys

pyt_path = r'C:\Program Files (x86)\IronPython 2.7\Lib'
sys.path.append(pyt_path)

import os

username = os.environ.get( "USERNAME" )

OUT = "C:\\Users\\" + username + "\\AppData\\Roaming\\Dynamo\\Dynamo Revit\\2.0\\PythonTemplate.py"
# ----------------------------------------
sendTo = Custom[Clipboard.SendTo](str=python_script)  # Copies a string to the clipboard.
