# Dynamo graph AS224711-00-Wrappers.dyn "AS224711-02-ElementPinnedModifiers_begin" (Dynamo 2.0.1.5055)

select_model_element = DSModelElementSelection()  # 1 picked in the model

# group: The internal Revit API way of things
unwrapped_internal_revit_element = Python(IN[0]=select_model_element)
# ---------- unwrapped_internal_revit_element.python (3 lines) ----------
element = UnwrapElement(IN[0])

OUT = element.GetType()
# ----------------------------------------
unwrapped_internal_revit_element_2 = Python(IN[0]=select_model_element)
# ---------- unwrapped_internal_revit_element_2.python (3 lines) ----------
element = UnwrapElement(IN[0])

OUT = dir(element)
# ----------------------------------------
what_is_potentially_possible = Watch(unwrapped_internal_revit_element_2)

# group: The user readable Dynamo way of things
wrapped_dynamo_revit_element = Python(IN[0]=select_model_element)
# ---------- wrapped_dynamo_revit_element.python (4 lines) ----------
element = IN[0]


OUT = dir(element)
# ----------------------------------------
what_is_potentially_possible_2 = Watch(wrapped_dynamo_revit_element)
type = Object.Type(obj=select_model_element)
