# Dynamo graph AS224711-01-StringsToUpper_end.dyn "01_End" (Dynamo 2.0.1.5055)

code_block = CodeBlock()
# ---------- code_block.designscript (4 lines) ----------
//This is a single item
"hello";
//This is a list with one item
["hello"];
# ----------------------------------------
watch = Watch(code_block.out1)
python_script = Python(IN[0]=watch)
# ---------- python_script.python (19 lines) ----------
# Enable Python support and load DesignScript library
import clr
clr.AddReference('ProtoGeometry')
from Autodesk.DesignScript.Geometry import *

# The inputs to this node will be stored as a list in the IN variables.
dataEnteringNode = IN
# we need to assign the input to a variable
strings = IN[0]

# we need a variable to output the results [] = empty list
upperStrings = []

# this allows us to do the action to each item in the list
for i in strings:	
	upperStrings.append(i.upper())
	
# Assign your output to the OUT variable.
OUT = upperStrings
# ----------------------------------------
watch_2 = Watch(code_block.out0)
# note: Flatten the input into a list
flatten = List.Flatten(list=watch_2)
python_script_2 = Python(IN[0]=flatten)  # same code as python_script
