# Dynamo graph AS224711-02-ElementPinnedModifiers_begin.dyn (Dynamo 2.0.1.5055)

python_script = Python()  # unwired: IN[0]
# ---------- python_script.python (39 lines) ----------
# import common language runtime (allows us to load other .NET libraries)
import clr

# clr.AddReference loads and imports .net assembly(dll) as python module and import all of its classes
clr.AddReference('RevitAPI')
from Autodesk.Revit.DB import *

# import Revit UI classes
clr.AddReference('RevitAPIUI')
from Autodesk.Revit.UI import *

clr.AddReference('System')
from System.Collections.Generic import List

# import Dynamo Revit nodes and converters
clr.AddReference('RevitNodes')
import Revit
clr.ImportExtensions(Revit.GeometryConversion)
clr.ImportExtensions(Revit.Elements)

# import Transaction methods and Document helpers
clr.AddReference('RevitServices')
import RevitServices
from RevitServices.Persistence import DocumentManager
from RevitServices.Transactions import TransactionManager

# access to the active document and active ui document
doc = DocumentManager.Instance.CurrentDBDocument
uidoc=DocumentManager.Instance.CurrentUIApplication.ActiveUIDocument

#Preparing input from dynamo to revit
element = UnwrapElement(IN[0])

#Do some action in a Transaction
TransactionManager.Instance.EnsureInTransaction(doc)

TransactionManager.Instance.TransactionTaskDone()

OUT = element
# ----------------------------------------
