# Dynamo graph AS224711-02-ElementPinnedModifiers_end.dyn (Dynamo 2.0.1.5055)

select_model_element = DSModelElementSelection()  # 1 picked in the model
flatten = List.Flatten(list=select_model_element)
python_script_pinned_status_get = Python(IN[0]=flatten)
# ---------- python_script_pinned_status_get.python (35 lines) ----------
# Python template for Revit
import clr

clr.AddReference('RevitAPI')
from Autodesk.Revit.DB import *
from Autodesk.Revit.DB.Structure import *

clr.AddReference('RevitAPIUI')
from Autodesk.Revit.UI import *

clr.AddReference('System')
from System.Collections.Generic import List

clr.AddReference('RevitNodes')
import Revit
clr.ImportExtensions(Revit.GeometryConversion)
clr.ImportExtensions(Revit.Elements)

clr.AddReference('RevitServices')
import RevitServices
from RevitServices.Persistence import DocumentManager
from RevitServices.Transactions import TransactionManager

doc = DocumentManager.Instance.CurrentDBDocument
uidoc=DocumentManager.Instance.CurrentUIApplication.ActiveUIDocument

#Preparing input from dynamo to revit
element = UnwrapElement(IN[0])

#Do some action in a Transaction
TransactionManager.Instance.EnsureInTransaction(doc)

TransactionManager.Instance.TransactionTaskDone()

OUT = element
# ----------------------------------------
boolean = BoolSelector(false)
python_script_pinned_status_set = Python(IN[0]=flatten, IN[1]=boolean)
# ---------- python_script_pinned_status_set.python (41 lines) ----------
# Python template for Revit
import clr

clr.AddReference('RevitAPI')
from Autodesk.Revit.DB import *
from Autodesk.Revit.DB.Structure import *

clr.AddReference('RevitAPIUI')
from Autodesk.Revit.UI import *

clr.AddReference('System')
from System.Collections.Generic import List

clr.AddReference('RevitNodes')
import Revit
clr.ImportExtensions(Revit.GeometryConversion)
clr.ImportExtensions(Revit.Elements)

clr.AddReference('RevitServices')
import RevitServices
from RevitServices.Persistence import DocumentManager
from RevitServices.Transactions import TransactionManager

doc = DocumentManager.Instance.CurrentDBDocument
uidoc=DocumentManager.Instance.CurrentUIApplication.ActiveUIDocument

#Preparing input from dynamo to revit
elements = UnwrapElement(IN[0])
toggle = IN[1]

#List to output results
results = []
#Do some action in a Transaction
TransactionManager.Instance.EnsureInTransaction(doc)

for i in elements:
	i.Pinned = toggle

TransactionManager.Instance.TransactionTaskDone()

OUT = elements
# ----------------------------------------
python_script_pinned_status_get_2 = Python(IN[0]=flatten)  # "Python Script - Pinned Status (Get + Set)"; unwired: IN[1]
# ---------- python_script_pinned_status_get_2.python (46 lines) ----------
# Python template for Revit
import clr

clr.AddReference('RevitAPI')
from Autodesk.Revit.DB import *
from Autodesk.Revit.DB.Structure import *

clr.AddReference('RevitAPIUI')
from Autodesk.Revit.UI import *

clr.AddReference('System')
from System.Collections.Generic import List

clr.AddReference('RevitNodes')
import Revit
clr.ImportExtensions(Revit.GeometryConversion)
clr.ImportExtensions(Revit.Elements)

clr.AddReference('RevitServices')
import RevitServices
from RevitServices.Persistence import DocumentManager
from RevitServices.Transactions import TransactionManager

doc = DocumentManager.Instance.CurrentDBDocument
uidoc=DocumentManager.Instance.CurrentUIApplication.ActiveUIDocument

#Preparing input from dynamo to revit
elements = UnwrapElement(IN[0])
toggle = IN[1]

#List to output results
results = []
#Do some action in a Transaction
TransactionManager.Instance.EnsureInTransaction(doc)

for i in elements:
	if toggle == None:
		results.append(i.Pinned)		
	else:
		i.Pinned = toggle
		results.append(i)
		

TransactionManager.Instance.TransactionTaskDone()

OUT = results
# ----------------------------------------
boolean_2 = BoolSelector(false)
