# Dynamo graph AS224711-03-ShowHideGridBubbles-Bonus_end.dyn "AS224711-02.1-ShowHideGridBubbles-Bonus_end" (Dynamo 2.0.1.5055)

categories = Categories(index=233)
isolated_pick_model_elements = Custom[Isolated Pick Model Elements](Category=categories)  # This allows a multiple selection of elements of specified category.
boolean = BoolSelector(true)
python_script = Python(IN[0]=isolated_pick_model_elements, IN[1]=boolean)
# ---------- python_script.python (46 lines) ----------
# Python template for Revit
import clr

clr.AddReference('RevitAPI')
from Autodesk.Revit.DB import *
from Autodesk.Revit.DB.Structure import *

clr.AddReference('RevitAPIUI')
from Autodesk.Revit.UI import *

clr.AddReference('System')
from System.Collections.Generic import List

clr.AddReference('RevitNodes')
import Revit
clr.ImportExtensions(Revit.GeometryConversion)
clr.ImportExtensions(Revit.Elements)

clr.AddReference('RevitServices')
import RevitServices
from RevitServices.Persistence import DocumentManager
from RevitServices.Transactions import TransactionManager

doc = DocumentManager.Instance.CurrentDBDocument
uidoc=DocumentManager.Instance.CurrentUIApplication.ActiveUIDocument

activeView = doc.ActiveView

#Preparing input from dynamo to revit
elements = UnwrapElement(IN[0])
toggle = IN[1]

#We need a transaction because we are making a change to the Revit model
TransactionManager.Instance.EnsureInTransaction(doc)

for i in elements:
	if toggle == True: #allows us to swap between the options
		i.ShowBubbleInView(DatumEnds.End1,activeView) #Show end 1 in the view
		i.HideBubbleInView(DatumEnds.End0,activeView) # hide end 0 in the view
	else:
		i.ShowBubbleInView(DatumEnds.End0,activeView) #Show end 0 in the view
		i.HideBubbleInView(DatumEnds.End1,activeView) # hide end 1 in the view

TransactionManager.Instance.TransactionTaskDone()

OUT = elements
# ----------------------------------------
