# Dynamo graph AS224711-03-ShowHideGridBubbles_begin.dyn "AS224711-02-ShowHideGridBubbles_begin" (Dynamo 2.0.1.5055)

categories = Categories(index=233)  # frozen
isolated_pick_model_elements = Custom[Isolated Pick Model Elements](Category=categories)  # This allows a multiple selection of elements of specified category.
python_script = Python(IN[0]=isolated_pick_model_elements)
# ---------- python_script.python (35 lines) ----------
# Python template for Revit
import clr

clr.AddReference('RevitAPI')
from Autodesk.Revit.DB import *
from Autodesk.Revit.DB.Structure import *

clr.AddReference('RevitAPIUI')
from Autodesk.Revit.UI import *

clr.AddReference('System')
from System.Collections.Generic import List

clr.AddReference('RevitNodes')
import Revit
clr.ImportExtensions(Revit.GeometryConversion)
clr.ImportExtensions(Revit.Elements)

clr.AddReference('RevitServices')
import RevitServices
from RevitServices.Persistence import DocumentManager
from RevitServices.Transactions import TransactionManager

doc = DocumentManager.Instance.CurrentDBDocument
uidoc=DocumentManager.Instance.CurrentUIApplication.ActiveUIDocument

#Preparing input from dynamo to revit
element = UnwrapElement(IN[0])

#Do some action in a Transaction
TransactionManager.Instance.EnsureInTransaction(doc)

TransactionManager.Instance.TransactionTaskDone()

OUT = element
# ----------------------------------------
