# Dynamo graph AS224711-05-ExtendTopBottomGrids_end.dyn (Dynamo 2.0.1.5055)

select_model_elements = DSModelElementsSelection()  # nothing selected; graph input
# note: **Clockwork v.2016.10.13
turnIntoList = Custom[TurnIntoList](unknownItem=select_model_elements)  # Turns an element (or a nested list) into a flat list
bottom = DoubleSlider(-67.6, range=-100..100 step 0.1)  # graph input
top = DoubleSlider(25.6, range=-100..100 step 0.1)  # graph input
python_script = Python(IN[0]=turnIntoList, IN[1]=bottom, IN[2]=top)
# ---------- python_script.python (39 lines) ----------
# Python template for Revit
import clr

clr.AddReference('RevitAPI')
from Autodesk.Revit.DB import *
from Autodesk.Revit.DB.Structure import *

clr.AddReference('RevitAPIUI')
from Autodesk.Revit.UI import *

clr.AddReference('System')
from System.Collections.Generic import List

clr.AddReference('RevitNodes')
import Revit
clr.ImportExtensions(Revit.GeometryConversion)
clr.ImportExtensions(Revit.Elements)

clr.AddReference('RevitServices')
import RevitServices
from RevitServices.Persistence import DocumentManager
from RevitServices.Transactions import TransactionManager

doc = DocumentManager.Instance.CurrentDBDocument
uidoc=DocumentManager.Instance.CurrentUIApplication.ActiveUIDocument

#Preparing input from dynamo to revit
grids = UnwrapElement(IN[0])
bottom = IN[1]
top = IN[2]

#Do some action in a Transaction
TransactionManager.Instance.EnsureInTransaction(doc)
for g in grids:
	g.SetVerticalExtents(bottom,top)

TransactionManager.Instance.TransactionTaskDone()

OUT = grids
# ----------------------------------------
